# Grasshopper definition 外包矩形.gh (Grasshopper 1.0.7)

crv = Curve(<curve referenced from the Rhino model>)
explode = Explode(Curve=crv, Recursive=True)  # -> Segments, Vertices
path = FilePath("D:\CODE\外包矩形.py")
item = ListItem(List=explode.Segments, Index=-1, Wrap=True)
line = Line(item)
file = ReadFile(File=path, PerLineParse=False)
trigger = Trigger(Interval=-1000, TimerInterval=1000, Target=python)
python = GhPythonScript(Code=file, Curve=crv, X_derection_line=line)  # -> Out, Bdrec
crv_2 = Curve(python.Bdrec)
panel = Panel(python.Out)
